# Grasshopper definition A2 Parametric.gh (Grasshopper 1.0.7)

point = Point(Point(19.42570576, -0.09323297197, 0))
# Definition:
# 
# This is a pentagon with 5 insert slots with gap
# lengths equal to the depth of the cardboard.
# 
# Using the number sliders below, input the
# depth (in mm) of the cardboard being used.
number_slider = Slider(10, range=0..10)
rectangle = Rectangle(Plane=point, XSize=Slider(10, range=0..10), YSize=Slider(10, range=0..10), Radius=number_slider)  # -> Rectangle, Length
# Inputs and sliders
origin_center_point = Point(Point(-0.01401691914, -0.0003126304434, 0))
sizeradius_in_mm = Slider(10, range=0..10)
numsides = Slider(6, range=3..10)
cardboardthickness = Slider(4.3, range=0..10)
slotdepth = Slider(1, range=0..10)
# Create the polygon and its curves
polygon = Polygon(Plane=origin_center_point, Radius=sizeradius_in_mm, Segments=numsides, FilletRadius=0)  # -> Polygon, Length
polygon_brep = DeconstructBrep(Brep=polygon.Polygon)  # -> Faces, Edges, Vertices
# Side length
length = Length(Curve=polygon_brep.Edges)
# Midpoint of each side
curve_middle = CurveMiddle(Curve=polygon_brep.Edges)
boolean_toggle = BooleanToggle(True)
number_slider_2 = Slider(1, range=0..1)  # disabled
curve = Curve(polygon_brep.Edges)
addition = Addition(A=slotdepth, B=number_slider_2)  # disabled
vector_2pt = Vector2Pt(PointA=curve_middle, PointB=origin_center_point, Unitize=boolean_toggle)  # -> Vector, Length; disabled
division = Division(A=cardboardthickness, B=length)  # disabled
scale = Scale(Geometry=curve, Center=curve_middle, Factor=division)  # -> Geometry, Transform; disabled
amplitude = Amplitude(Vector=vector_2pt.Vector, Amplitude=addition)  # disabled
vector_2pt_2 = Vector2Pt(PointA=origin_center_point, PointB=curve_middle, Unitize=boolean_toggle)  # -> Vector, Length; disabled
extrude = Extrude(Base=scale.Geometry, Direction=amplitude)  # disabled
move = Move(Geometry=extrude, Motion=vector_2pt_2.Vector)  # -> Geometry, Transform; disabled
curve_2 = Curve(polygon_brep.Faces)
trim_with_regions = TrimWithRegions(Curve=move.Geometry, Regions=curve_2)  # -> Inside, Outside; disabled
trim_with_regions_2 = TrimWithRegions(Curve=curve_2, Regions=move.Geometry)  # -> Inside, Outside; disabled
curve_3 = Curve(flatten(trim_with_regions.Inside))
curve_4 = Curve(trim_with_regions.Outside)
curve_5 = Curve(flatten(trim_with_regions_2.Outside))
curve_6 = Curve(trim_with_regions_2.Inside)
join_curves = JoinCurves(Curves=[curve_5, curve_3], Preserve=False)  # disabled
