# Grasshopper definition A5 Voronoi Vases Grasshopper.gh (Grasshopper 1.0.7)
# plug-ins: Kangaroo2 Components, DendroGH

domain = Slider(20, range=0..200)
steps = Slider(5, range=0..20)
range = Range(Domain=Domain(0, 1), Steps=steps)
range_2 = Range(Domain=domain, Steps=steps)
domain_end = Slider(9, range=0..50)
domain_start = Slider(8, range=0..50)
graph_mapper = GraphMapper(range, x0=0, x1=1, y0=0, y1=1, container_name="Gaussian", factor=0.2, mean=0.3099767566, sdev=0.1)
construct_domain = ConstructDomain(DomainStart=domain_start, DomainEnd=domain_end)
bounds = Bounds(Numbers=graph_mapper)
remap_numbers = RemapNumbers(Value=graph_mapper, Source=bounds, Target=construct_domain)  # -> Mapped, Clipped
construct_point = ConstructPoint(XCoordinate=remap_numbers.Mapped, YCoordinate=0, ZCoordinate=range_2)
xy_plane = XYPlane(Origin=Point(0, 0, 0))
nurbs_curve = NurbsCurve(Vertices=construct_point, Degree=3, Periodic=False)  # -> Curve, Length, Domain
line_sdl = LineSDL(Start=xy_plane, Direction=xy_plane, Length=1)
revolution = Revolution(Curve=nurbs_curve.Curve, Axis=line_sdl, Domain=Domain(0, 6.283185307))
data_dam = DataDam(DataDataA=revolution, BufferDelay=10000000, BufferMode=1)
count = Slider(83, range=0..200)
populate_geometry = PopulateGeometry(Geometry=data_dam, Count=count, Seed=Slider(3, range=0..10))
edges = BrepEdges(Brep=data_dam)  # -> Naked, Interior, NonManifold
midpt = CurveMiddle(Curve=edges.Naked)
voronoi_3d = Voronoi3D(Points=populate_geometry, Box=data_dam)  # -> Cells, Boundary
pdecon = Deconstruct(Point=midpt)  # -> XComponent, YComponent, ZComponent
sort = SortList(Keys=pdecon.ZComponent, ValuesA=edges.Naked)  # -> Keys, ValuesA
brep_brep = BrepBrep(BrepA=data_dam, BrepB=voronoi_3d.Cells, UseTasks=True)  # -> flatten(Curves), Points
item = ListItem(List=sort.ValuesA, Index=0, Wrap=True)
dim = Dimensions(Surface=data_dam)  # -> UDimension, VDimension
disc = Discontinuity(Curve=brep_brep.Curves, Level=1)  # -> Points, Parameters
avr = Average(Input=disc.Points)  # -> flatten(ArithmeticMean)
multiplication = Multiplication(A=dim.VDimension, B=Slider(0.452, range=0..1))
pdecon_2 = Deconstruct(Point=avr)  # -> XComponent, YComponent, ZComponent
larger = LargerThan(FirstNumber=pdecon_2.ZComponent, SecondNumber=multiplication)  # -> LargerThan, OrEqualTo
cull = CullPattern(List=brep_brep.Curves, CullPattern=larger.LargerThan)
srfsplit = SurfaceSplit(Surface=data_dam, Curves=cull)
area = Area(Geometry=srfsplit)  # -> Area, Centroid
sort_2 = SortList(Keys=area.Area, ValuesA=srfsplit)  # -> Keys, reverse(ValuesA)
explode = Explode(Curve=cull, Recursive=True)  # -> flatten(Segments), Vertices
boundary = BoundarySurfaces(Edges=item)
item_2 = ListItem(List=sort_2.ValuesA, Index=0, Wrap=True)
divlength = DivideLength(Curve=explode.Segments, Length=Slider(0.06, range=0..1))  # -> flatten(Points), Tangents, Parameters
number_slider = Slider(0.06, range=0..1)
join = BrepJoin(Breps=flatten([item_2, boundary]))  # -> Breps, Closed
duppt = RemoveDuplicatePts(Points=flatten(divlength.Points), Tolerance=0.01)
triremesh = TriRemesh(Geometry=join.Breps, Length=Slider(0.6, range=0..10), Iterations=25)  # -> Triangulation, Dual, Creases
multiplication_2 = Multiplication(A=Slider(5.6, range=0..10), B=number_slider)
vsettings = CreateSettings(VoxelSize=number_slider, Bandwidth=1, Isovalue=0, Adaptivity=0.1)
vpoints = PointsToVolume(Points=duppt, PointRadius=multiplication_2, Settings=vsettings)
vmesh = MeshToVolume(Mesh=triremesh.Triangulation, Settings=vsettings)
voffset = OffsetVolume(Volume=vmesh, Distance=multiplication_2)
vunion = VolumeUnion(Volumes=flatten([vpoints, voffset]))
